# Grasshopper definition run_ghe_designer.gh (Grasshopper 1.0.7)
# plug-ins: CORE.Toolbox.Grasshopper

# ---- group: Set to True to Read Excel File
toggle = BooleanToggle(True)

# ---- group: Set the Path to the Plant Load Excel File
path = FilePath("C:\Users\chris\Downloads\2024-0209 plant loads.xlsx")

# ---- group: Process Excel of Hourly Loads in Btu/h into Watts
xl_in = ReadFromExcel(WorkbookFilepath=path, Live=False, Stream=toggle)
flip = FlipMatrix(Data=xl_in)
panel = Panel("""0
1""")
panel_2 = Panel("""2
3
4
5""")
cull_i = CullIndex(List=flip, Indices=panel, Wrap=True)  # -> simplify(List)
branch = TreeBranch(Tree=cull_i, Path=panel_2, MaintainPaths=True)
units = LBUnitConverter(values=branch, from_u="Btu/h", to_u="W")  # -> all_u, values; plug-in component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
bang = ExplodeTree(Data=units.values)  # -> Branch0, Branch1, Branch2, Branch3
neg = Negative(Value=bang.Branch0)
neg_2 = Negative(Value=bang.Branch1)
constrheader = LBConstructHeader(data_type="Power", unit="W")  # -> header; plug-in component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
addition = Addition(A=neg, B=neg_2, C=bang.Branch2, D=bang.Branch3)
python = GhPythonScript()  # -> out, a
# ---------- python: Python ----------
data = {
  "version": "1.5",
  "fluid": {
    "fluid_name": "WATER",
    "concentration_percent": 0.0,
    "temperature": 20
  },
  "grout": {
    "conductivity": 1.0,
    "rho_cp": 3901000
  },
  "soil": {
    "conductivity": 2.0,
    "rho_cp": 2343493,
    "undisturbed_temp": 18.3
  },
  "pipe": {
    "inner_diameter": 0.03404,
    "outer_diameter": 0.04216,
    "shank_spacing": 0.01856,
    "roughness": 1e-06,
    "conductivity": 0.4,
    "rho_cp": 1542000,
    "arrangement": "SINGLEUTUBE"
  },
  "borehole": {
    "buried_depth": 2.0,
    "diameter": 0.14
  },
  "simulation": {
    "num_months": 240
  },
  "geometric_constraints": {
    "b_min": 5.0,
    "b_max_x": 25.0,
    "b_max_y": 25.0,
    "max_height": 135.0,
    "min_height": 60.0,
    "property_boundary": [[
      [19.46202532, 108.8860759],
      [19.67827004, 94.46835443],
      [24.65189873, 75.3164557],
      [37.19409283, 56.59493671],
      [51.68248945, 45.83544304],
      [84.33544304, 38.94936709],
      [112.0147679, 38.94936709],
      [131.0443038, 35.50632911],
      [147.2626582, 28.83544304],
      [160.8860759, 18.07594937],
      [171.6983122, 18.29113924],
      [167.157173, 72.94936709],
      [169.1033755, 80.48101266],
      [177.3206751, 99.63291139],
      [182.2943038, 115.7721519],
      [182.2943038, 121.3670886],
      [155.0474684, 118.5696203],
      [53.19620253, 112.3291139]
    ]],
    "no_go_boundaries": [[
      [74.38818565, 80.69620253],
      [73.0907173, 53.36708861],
      [93.85021097, 52.50632911],
      [120.0158228, 53.15189873],
      [121.5295359, 62.18987342],
      [128.8818565, 63.26582278],
      [128.8818565, 78.5443038],
      [129.0981013, 80.91139241],
      [108.5548523, 81.34177215],
      [104.0137131, 110],
      [95.58016878, 110],
      [95.7964135, 81.7721519]
    ]],
    "method": "BIRECTANGLECONSTRAINED"
  },
  "design": {
    "flow_rate": 0.5,
    "flow_type": "BOREHOLE",
    "max_eft": 35.0,
    "min_eft": 5.0
  },
  "loads": {
    "ground_loads": [
      0,
      0,
      0,
      0,
      0,
      0,
      0,
      0,
      0,
      0,
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    ]
  }
}
a = data['loads']['ground_loads']
# ---------- end python ----------
data = LBConstructData(header=constrheader, values=python.a)  # -> data; plug-in component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

# ----
number_slider = Slider(35, range=5..50)
number_slider_2 = Slider(7, range=0..15)
ghedesigner = HBGHEDesigner(min_depth=Slider(150, range=100..300), max_depth=Slider(500, range=300..600))  # -> geo_constr; plug-in component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
site_geometry = Geometry(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)
site_geometry_2 = Geometry(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)
ghedesigner_2 = HBGHEDesigner(load=data, site=site_geometry_2, geo_constr=ghedesigner, write=Toggle(True))  # -> report, input_json, boreholes, g_function, idf_text; plug-in component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
panel_3 = Panel(ghedesigner_2.report)
