# Grasshopper definition sample_gshp_plant_FINAL.gh (Grasshopper 1.0.7)
# plug-ins: Ironbug.Grasshopper, CORE.Toolbox.Grasshopper

# ---- group: Set to True to Read Excel File
toggle = BooleanToggle(False)

# ---- group: Set the Path to the Plant Load Excel File
path = FilePath("C:\Users\chris\Downloads\2024-0209 plant loads.xlsx")

# ----
# Import Building Loads From Excel File
xl_in = ReadFromExcel(WorkbookFilepath=path, Live=False, Stream=toggle)
building_loads = Data(Tree({0;1}: ["", "", "MTCHW", "LTCHW", "HHW", "DHW"], {0;2}: ["Date", "Time", "CHWL total load (Btu/h)", "CHWL total load (Btu/h)", "HWL total load (Btu/h)", "HWL total load (Btu/h)"], {0;3}: ["Fri, 01/Jan", "0.0208333333333333", "555306", "56814", "344335", "1752"], {0;4}: ["", "0.0625", "543551", "2068", "603971", "1752"], {0;5}: ["", "0.104166666666667", "531750", "0", "693080", "1752"], {0;6}: ["", "0.145833333333333", "533603", "0", "799130", "1752"]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))
flip = FlipMatrix(Data=building_loads)
panel = Panel("""0
1""")
cull_i = CullIndex(List=flip, Indices=panel, Wrap=True)  # -> simplify(List)
panel_2 = Panel("""2
3
4
5""")
branch = TreeBranch(Tree=cull_i, Path=panel_2, MaintainPaths=True)
units = LBUnitConverter(values=branch, from_u="Btu/h", to_u="W")  # -> all_u, values; plug-in component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
multiplication = Multiplication(A=units.values, B="1")
bang = ExplodeTree(Data=multiplication)  # -> Branch0, Branch1, Branch2, Branch3
addition = Addition(A=bang.Branch2, B=bang.Branch3)
addition_2 = Addition(A=bang.Branch0, B=bang.Branch1)
cooling_load = Data(addition_2)
heaing_load = Data(addition)

site_geometry = Geometry(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)

# ----
# GHE DESIGNER AUTOSIZE,
#  G FUNCTION EXPORT
# AND BORE X,Y COORDINATES
cooling_load_w = Data(cooling_load)
heaing_load_w = Data(heaing_load)
neg = Negative(Value=cooling_load_w)
constrheader = LBConstructHeader(data_type="Power", unit="W")  # -> header; plug-in component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
addition_3 = Addition(A=neg, B=heaing_load_w)
data = LBConstructData(header=constrheader, values=addition_3)  # -> data; plug-in component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
gheborehole = DFGHEBoreholeParameter(
    min_spacing=Slider(7, range=0..15),
    max_spacing=Slider(36, range=5..50),
    min_depth=Slider(100, range=100..300),
    max_depth=Slider(450, range=300..600))  # -> geo_constr; plug-in component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
site_geometry_2 = Geometry(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)
toggle_2 = BooleanToggle(False)
ghedesigner = HBGHEDesigner(load=data, site=site_geometry_2, borehole=gheborehole, write=toggle_2, run=toggle_2)  # -> report, input_json, boreholes, g_function, properties; plug-in component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
panel_3 = Panel(ghedesigner.report)
geo = Geometry(ghedesigner.boreholes)

constrheader_2 = LBConstructHeader(data_type="Power", unit="W")  # -> header; plug-in component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
data_2 = LBConstructData(header=constrheader_2, values=cooling_load)  # -> data; plug-in component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
timeop = LBTimeIntervalOperation(data=data_2)  # -> daily, monthly, mon_per_hr; plug-in component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
xdata = LBDeconstructData(data=timeop.daily)  # -> header, values; plug-in component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
datadt = LBDataDateTimes(data=timeop.daily)  # -> hoys; plug-in component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
python = GhPythonScript(values=xdata.values, dates=datadt)  # -> out, max_date, max_val; inputs values: list, dates: list
# ---------- python: Python ----------
from ladybug.dt import Date

data = [(x, y) for y, x in sorted(zip(_values, _dates), key=lambda pair: pair[0])]
max_date = Date.from_doy(data[-1][0])
max_val = data[-1][1]
# ---------- end python ----------

panel_4 = Panel("https://energyplus-weather.s3.amazonaws.com/north_and_central_america_wmo_region_4/USA/NJ/USA_NJ_Trenton-Mercer.County.AP.724095_TMY3/USA_NJ_Trenton-Mercer.County.AP.724095_TMY3.zip")
downloadepw = LBDownloadWeather(weather_URL=panel_4)  # -> epw_file, stat_file, ddy_file; plug-in component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

# ----
# WEATHER FILE
# AND DESIGN DAYS
panel_5 = Panel("W")
constrheader_3 = LBConstructHeader(data_type="Power", unit=panel_5)  # -> header; plug-in component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
data_3 = LBConstructData(header=constrheader_3, values=heaing_load)  # -> data; plug-in component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
timeop_2 = LBTimeIntervalOperation(data=data_3)  # -> daily, monthly, mon_per_hr; plug-in component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
xdata_2 = LBDeconstructData(data=timeop_2.daily)  # -> header, values; plug-in component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
datadt_2 = LBDataDateTimes(data=timeop_2.daily)  # -> hoys; plug-in component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
python_2 = GhPythonScript(values=xdata_2.values, dates=datadt_2)  # -> out, max_date, max_val; inputs values: list, dates: list; same code as python

tounit = LBToUnit(data=[data_2, data_3], to_unit="TR")  # -> all_unit, data; plug-in component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
python_3 = GhPythonScript(x=tounit.data)  # -> a
# ---------- python_3: Python ----------
a = x.max * 0.000189  # convert to m3/s
# ---------- end python_3 ----------
multiplication_2 = Multiplication(A=python_3, B="10")
bang_2 = ExplodeTree(Data=multiplication_2)  # -> flatten(Branch0), flatten(Branch1)

# ----
# Properties of the GHE
# from the IDF File Contents
bang_3 = ExplodeTree(Data=simplify(graft(ghedesigner.properties)))  # -> Branch0, Branch1, Branch2, Branch3, Branch4, Branch5, Branch6, Branch7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
g_function = Data(flatten(ghedesigner.g_function))
objparams = IB_ObjParams(
    BoreHoleLength=bang_3.Branch0,
    BoreHoleRadius=bang_3.Branch1,
    DesignFlowRate=bang_3.Branch2,
    GroundTemperature=bang_3.Branch3,
    GroundThermalConductivity=bang_3.Branch4,
    GroundThermalHeatCapacity=bang_3.Branch5,
    GroutThermalConductivity=bang_3.Branch6,
    NumberofBoreHoles=bang_3.Branch7,
    PipeOutDiameter=bang_3.Branch8,
    PipeThermalConductivity=bang_3.Branch9,
    PipeThickness=bang_3.Branch10,
    UTubeDistance=bang_3.Branch11,
    DataFieldSetType="Ironbug.HVAC.IB_GroundHeatExchangerVertical_FieldSet")

# ----
# Auxilary Air-Source
# Chiller / Heat Pump
# Cooling
# Heating
clnhp_airsource = IB_HeatPumpPlantLoopEIRCooling_AirSource(dupNum=False)
htnhp_airsource = IB_HeatPumpPlantLoopEIRHeating_AirSource(dupNum=False)

# ----
# Water-to-Water
# Heat Pumps
heatpumpheating = IB_HeatPumpWaterToWaterEquationFitHeating(dupNum=False)  # -> HP, toSupplySide
heatpumpcooling = IB_HeatPumpWaterToWaterEquationFitCooling(dupNum=False)  # -> HP, toSupplySide

importddy = LBImportDDY(ddy_file=downloadepw.ddy_file)  # -> location, design_days, cooling_ddy, heating_ddy; plug-in component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
decnstrdesignday = LBDeconstructDesignDay(design_day=importddy.cooling_ddy)  # -> name, day_type, location, date, dry_bulb_max, dry_bulb_range, humidity_type, humidity_value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; plug-in component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
decnstrdesignday_2 = LBDeconstructDesignDay(design_day=importddy.heating_ddy)  # -> name, day_type, location, date, dry_bulb_max, dry_bulb_range, humidity_type, humidity_value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; plug-in component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
constrdesignday = DFConstructDesignDay(
    name=decnstrdesignday.name,
    day_type=decnstrdesignday.day_type,
    location=decnstrdesignday.location,
    date=python.max_date,
    dry_bulb_max=decnstrdesignday.dry_bulb_max,
    dry_bulb_range=decnstrdesignday.dry_bulb_range,
    humidity_type=decnstrdesignday.humidity_type,
    humidity_value=decnstrdesignday.humidity_value,
    barometric_p=decnstrdesignday.barometric_p,
    wind_speed=decnstrdesignday.wind_speed,
    wind_dir=decnstrdesignday.wind_dir,
    sky_type=decnstrdesignday.sky_type,
    sky_properties=decnstrdesignday.sky_properties)  # -> design_day; plug-in component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
constrdesignday_2 = DFConstructDesignDay(
    name=decnstrdesignday_2.name,
    day_type=decnstrdesignday_2.day_type,
    location=decnstrdesignday_2.location,
    date=python_2.max_date,
    dry_bulb_max=decnstrdesignday_2.dry_bulb_max,
    dry_bulb_range=decnstrdesignday_2.dry_bulb_range,
    humidity_type=decnstrdesignday_2.humidity_type,
    humidity_value=decnstrdesignday_2.humidity_value,
    barometric_p=decnstrdesignday_2.barometric_p,
    wind_speed=decnstrdesignday_2.wind_speed,
    wind_dir=decnstrdesignday_2.wind_dir,
    sky_type=decnstrdesignday_2.sky_type,
    sky_properties=decnstrdesignday_2.sky_properties)  # -> design_day; plug-in component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
writeddy = DFWriteDDY(location=importddy.location, design_days=flatten([constrdesignday, constrdesignday_2]), run=Toggle(True))  # -> ddy_file; plug-in component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
sizingpar = HBSizingParameter(ddy_file=writeddy)  # -> sizing; plug-in component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
simpar = HBSimulationParameter(timestep=6, sizing=sizingpar)  # -> sim_par; plug-in component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

python_4 = GhPythonScript(loads=cooling_load, name="HHW")  # -> csv_file; inputs loads: list
# ---------- python_4: Python ----------
import os
from honeybee.config import folders
from ladybug_rhino.grasshopper import all_required_inputs

if all_required_inputs(ghenv.Component):
    folder = folders.default_simulation_folder
    csv_file = os.path.join(folder, '{}.csv'.format(_name))
    with open(csv_file, 'w') as csv_f:
        csv_f.write('\n'.join(str(v) for v in _loads))
# ---------- end python_4 ----------
schedulefile = IB_ScheduleFile(_csvFile=python_4, dupNum=False)
objparams_2 = IB_ObjParams(LoadSchedule=schedulefile, PeakFlowRate=bang_2.Branch1, DataFieldSetType="Ironbug.HVAC.IB_LoadProfilePlant_FieldSet")
loadprofile = IB_LoadProfilePlant(Parameters_=objparams_2, dupNum=False)

python_5 = GhPythonScript(loads=heaing_load, name="LTCHW")  # -> csv_file; inputs loads: list; same code as python_4
schedulefile_2 = IB_ScheduleFile(_csvFile=python_5, dupNum=False)
objparams_3 = IB_ObjParams(LoadSchedule=schedulefile_2, PeakFlowRate=bang_2.Branch0, DataFieldSetType="Ironbug.HVAC.IB_LoadProfilePlant_FieldSet")
loadprofile_2 = IB_LoadProfilePlant(Parameters_=objparams_3, dupNum=False)

# ----
# Hot water loop
panel_6 = Panel("1.0095")
objparams_4 = IB_ObjParams(
    Coefficient1OfthePartLoadPerformanceCurve="0",
    Coefficient2OfthePartLoadPerformanceCurve="0.0216",
    Coefficient3OfthePartLoadPerformanceCurve="-0.0325",
    Coefficient4OfthePartLoadPerformanceCurve=panel_6,
    RatedFlowRate=bang_2.Branch1,
    RatedPumpHead="120000",
    DataFieldSetType="Ironbug.HVAC.IB_PumpVariableSpeed_FieldSet")
exit_temp_c = Panel("54.444")
pumpvariable = Ironbug_PumpVariableSpeed(Parameters=objparams_4, dupNum=False)
spm_scheduled = Ironbug_SetpointManagerScheduled(Temperature=exit_temp_c, dupNum=False)
branches = PlantBranches(Branch1=heatpumpheating.toSupplySide, mapBranchToLoop=False)
branches_2 = PlantBranches(Branch1=loadprofile, mapBranchToLoop=False)
objparams_5 = IB_ObjParams(Name="Hot Water Loop", DataFieldSetType="Ironbug.HVAC.IB_PlantLoop_FieldSet")
hwloop = Ironbug_HotWaterPlantLoop(Supply=[pumpvariable, branches, spm_scheduled], Demand=branches_2, Parameters=objparams_5, dupNum=False)

# ----
# Low temp chilled water loop
panel_7 = Panel("0")
objparams_6 = IB_ObjParams(
    Coefficient1OfthePartLoadPerformanceCurve=panel_7,
    Coefficient2OfthePartLoadPerformanceCurve="0.0216",
    Coefficient3OfthePartLoadPerformanceCurve="-0.0325",
    Coefficient4OfthePartLoadPerformanceCurve="1.0095",
    RatedFlowRate=bang_2.Branch0,
    RatedPumpHead="120000",
    DataFieldSetType="Ironbug.HVAC.IB_PumpVariableSpeed_FieldSet")
exit_temp_c_2 = Panel("5.555")
pumpvariable_2 = Ironbug_PumpVariableSpeed(Parameters=objparams_6, dupNum=False)
plantbranches = PlantBranches(Branch1=heatpumpcooling.toSupplySide, mapBranchToLoop=False)
spm_scheduled_2 = Ironbug_SetpointManagerScheduled(Temperature=exit_temp_c_2, dupNum=False)
branches_3 = PlantBranches(Branch=loadprofile_2, mapBranchToLoop=False)
objparams_7 = IB_ObjParams(Name="Low Temperature Chilled Water Loop", DataFieldSetType="Ironbug.HVAC.IB_PlantLoop_FieldSet")
cwloop = Ironbug_ChilledWaterPlantLoop(Supply=[pumpvariable_2, plantbranches, spm_scheduled_2], Demand=branches_3, Parameters_=objparams_7, dupNum=False)

# ----
# Ground Loop
groundhxvertical = Ironbug_GroundHeatExchangerVertical(GFunctions=g_function, Parameters_=objparams, dupNum=False)
minimum_loop_temp_c = Panel("10")
maximum_loop_temp_c = Panel("29.444")
pipeadiabatic = IB_PipeAdiabatic(dupNum=False)
pipeadiabatic_2 = Ironbug_PipeAdiabatic(dupNum=False)
merge = Merge(Data1=flatten(groundhxvertical), Data2=flatten(clnhp_airsource), Data3=flatten(htnhp_airsource))
pumpvariable_3 = Ironbug_PumpVariableSpeed(Parameters_=objparams_6, dupNum=False)
branches_4 = PlantBranches(B1=pipeadiabatic, B2=merge, mapBranchToLoop=False)
objparams_8 = IB_ObjParams(Name="Ground Exchanger Loop", DataFieldSetType="Ironbug.HVAC.IB_PlantLoop_FieldSet")
spm_dual = IB_SetpointManagerScheduledDualSetpoint(HighTemperature=maximum_loop_temp_c, LowTemperature=minimum_loop_temp_c, dupNum=False)
plantbranches_2 = PlantBranches(B1=heatpumpheating.HP, B2=pipeadiabatic_2, B3=heatpumpcooling.HP, mapBranchToLoop=False)
merge_2 = Merge(Data1=flatten(pumpvariable_3), Data2=flatten(branches_4), Data3=flatten(spm_dual))
condenserwaterloop = Ironbug_CondenserWaterPlantLoop(Supply=merge_2, Demand=plantbranches_2, Parameters_=objparams_8, dupNum=False)

cluster = Cluster()
modeltoosm = HBModelToOSM(model=cluster, epw_file=downloadepw.epw_file, sim_par=simpar, write=Toggle(True), run="2")  # -> report, jsons, osw, osm, idf, sql, zsz, rdd, html; plug-in component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

merge_3 = Merge(Data1=cwloop, Data2=hwloop, Data3=condenserwaterloop)
hvacsystem = Ironbug_HVACSystem(PlantLoops=flatten(merge_3))
savetofile = IB_SaveToFile(NewFilePath=modeltoosm.osm, HVACSystem=hvacsystem, _write=Toggle(True), OverrideMode=False, writeMode=0)
toggle_3 = BooleanToggle(False)
runosm = HBRunOSM(osm=savetofile, epw_file=downloadepw.epw_file, translate=toggle_3, run=toggle_3)  # -> report, idf, sql, zsz, rdd, html; plug-in component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
openfile = LBOpenFile(file_path=runosm.html)  # -> report; plug-in component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
savetofile_2 = IB_SaveToFile(_write=False, OverrideMode=False, writeMode=0)
hvactemplate = IB_HVACTemplate()

# ----
# EIR
panel_8 = Panel("40")
panel_9 = Panel("""0.92763489
-0.00667789
0.00022986
-0.00161427
0.000092
-0.0002995""")
objparams_9 = IB_ObjParams(
    MaximumValueofx="95",
    MaximumValueofy="46",
    MinimumValueofx="70",
    MinimumValueofy=panel_8,
    DataFieldSetType="Ironbug.HVAC.Curves.IB_CurveBiquadratic_FieldSet")
curvebiquadratic = Ironbug_CurveBiquadratic(Coefficients=panel_9, Parameters_=objparams_9, dupNum=False)

# ----
# Capacity
panel_10 = Panel("40")
# Reference:
# https://github.com/NREL/EnergyPlus/blob/bee886ab567181a306a8c2e7c678d6a1063b0bb0/testfiles/CentralChillerHeaterSystem_Simultaneous_Cooling_Heating.idf
panel_11 = Panel("""0.43949801
0.00056385
-0.00001518
0.01713529
0.00011668
-0.00009652""")
objparams_10 = IB_ObjParams(
    MaximumValueofx="95",
    MaximumValueofy="46",
    MinimumValueofx="70",
    MinimumValueofy=panel_10,
    DataFieldSetType="Ironbug.HVAC.Curves.IB_CurveBiquadratic_FieldSet")
curvebiquadratic_2 = Ironbug_CurveBiquadratic(Coefficients=panel_11, Parameters_=objparams_10, dupNum=False)

objparams_11 = IB_ObjParams(
    CoolingModeCoolingCapacityFunctionOfTemperatureCurve=curvebiquadratic_2,
    CoolingModeElectricInputToCoolingOutputRatioFunctionOfTemperatureCurve=curvebiquadratic,
    HeatingModeCoolingCapacityFunctionOfTemperatureCurve=curvebiquadratic_2,
    HeatingModeElectricInputToCoolingOutputRatioFunctionOfTemperatureCurve=curvebiquadratic,
    ReferenceCoolingModeCOP="5.5",
    ReferenceCoolingModeEvaporatorCapacity="12500",
    DataFieldSetType="Ironbug.HVAC.IB_ChillerHeaterPerformanceElectricEIR_FieldSet")

objparams_12 = IB_ObjParams(NumberofChillerHeaterModules="3", DataFieldSetType="Ironbug.HVAC.IB_CentralHeatPumpSystemModule_FieldSet")
chillerheater = Ironbug_ChillerHeaterPerformanceElectricEIR(Parameters_=objparams_11, dupNum=False)  # -> flatten(ChillerHeaters)
chillerheatermodule = Ironbug_CentralHeatPumpSystemModule(ChillerHeater=chillerheater, Parameters_=objparams_12, dupNum=False)
centralheatpumpsystem = Ironbug_CentralHeatPumpSystem(ChillerHeaters=chillerheatermodule, dupNum=False)  # -> ToDW_Demand, ToCW_Supply, ToHW_Supply

# ----
# Reference DataSet:
# https://github.com/NREL/EnergyPlus/blob/e94c9babac891617b828ec1a5f6f44b33dac491b/datasets/GLHERefData.idf
panel_12 = Panel("""-14.583933,               !- G-Function Ln(T/Ts) Value 1
    -1.972435,                !- G-Function G Value 1
    -14.459771,               !- G-Function Ln(T/Ts) Value 2
    -1.918855,                !- G-Function G Value 2
    -14.335609,               !- G-Function Ln(T/Ts) Value 3
    -1.859847,                !- G-Function G Value 3
    -14.211447,               !- G-Function Ln(T/Ts) Value 4
    -1.795084,                !- G-Function G Value 4
    -14.087285,               !- G-Function Ln(T/Ts) Value 5
    -1.724279,                !- G-Function G Value 5
    -13.963123,               !- G-Function Ln(T/Ts) Value 6
    -1.647199,                !- G-Function G Value 6
    -13.838961,               !- G-Function Ln(T/Ts) Value 7
    -1.563689,                !- G-Function G Value 7
    -13.714800,               !- G-Function Ln(T/Ts) Value 8
    -1.473689,                !- G-Function G Value 8
    -13.590638,               !- G-Function Ln(T/Ts) Value 9
    -1.377264,                !- G-Function G Value 9
    -13.466476,               !- G-Function Ln(T/Ts) Value 10
    -1.274618,                !- G-Function G Value 10
    -13.342314,               !- G-Function Ln(T/Ts) Value 11
    -1.166121,                !- G-Function G Value 11
    -13.218152,               !- G-Function Ln(T/Ts) Value 12
    -1.052323,                !- G-Function G Value 12
    -13.093990,               !- G-Function Ln(T/Ts) Value 13
    -0.933960,                !- G-Function G Value 13
    -12.969828,               !- G-Function Ln(T/Ts) Value 14
    -0.811952,                !- G-Function G Value 14
    -12.845666,               !- G-Function Ln(T/Ts) Value 15
    -0.687385,                !- G-Function G Value 15
    -12.721504,               !- G-Function Ln(T/Ts) Value 16
    -0.561478,                !- G-Function G Value 16
    -12.597342,               !- G-Function Ln(T/Ts) Value 17
    -0.435532,                !- G-Function G Value 17
    -12.473181,               !- G-Function Ln(T/Ts) Value 18
    -0.310858,                !- G-Function G Value 18
    -12.349019,               !- G-Function Ln(T/Ts) Value 19
    -0.188706,                !- G-Function G Value 19
    -12.224857,               !- G-Function Ln(T/Ts) Value 20
    -0.070175,                !- G-Function G Value 20
    -12.100695,               !- G-Function Ln(T/Ts) Value 21
    0.043861,                 !- G-Function G Value 21
    -11.976533,               !- G-Function Ln(T/Ts) Value 22
    0.152817,                 !- G-Function G Value 22
    -11.852371,               !- G-Function Ln(T/Ts) Value 23
    0.256421,                 !- G-Function G Value 23
    -11.728209,               !- G-Function Ln(T/Ts) Value 24
    0.354716,                 !- G-Function G Value 24
    -11.604047,               !- G-Function Ln(T/Ts) Value 25
    0.448017,                 !- G-Function G Value 25
    -11.479885,               !- G-Function Ln(T/Ts) Value 26
    0.536839,                 !- G-Function G Value 26
    -11.355724,               !- G-Function Ln(T/Ts) Value 27
    0.621812,                 !- G-Function G Value 27
    -11.231562,               !- G-Function Ln(T/Ts) Value 28
    0.703595,                 !- G-Function G Value 28
    -11.107400,               !- G-Function Ln(T/Ts) Value 29
    0.782798,                 !- G-Function G Value 29
    -10.983238,               !- G-Function Ln(T/Ts) Value 30
    0.859943,                 !- G-Function G Value 30
    -10.859076,               !- G-Function Ln(T/Ts) Value 31
    0.935443,                 !- G-Function G Value 31
    -10.734914,               !- G-Function Ln(T/Ts) Value 32
    1.009606,                 !- G-Function G Value 32
    -10.610752,               !- G-Function Ln(T/Ts) Value 33
    1.082655,                 !- G-Function G Value 33
    -10.486590,               !- G-Function Ln(T/Ts) Value 34
    1.154746,                 !- G-Function G Value 34
    -10.362428,               !- G-Function Ln(T/Ts) Value 35
    1.225994,                 !- G-Function G Value 35
    -10.238267,               !- G-Function Ln(T/Ts) Value 36
    1.296483,                 !- G-Function G Value 36
    -10.114105,               !- G-Function Ln(T/Ts) Value 37
    1.366279,                 !- G-Function G Value 37
    -9.989943,                !- G-Function Ln(T/Ts) Value 38
    1.435438,                 !- G-Function G Value 38
    -9.865781,                !- G-Function Ln(T/Ts) Value 39
    1.504008,                 !- G-Function G Value 39
    -9.741619,                !- G-Function Ln(T/Ts) Value 40
    1.572032,                 !- G-Function G Value 40
    -9.617457,                !- G-Function Ln(T/Ts) Value 41
    1.639551,                 !- G-Function G Value 41
    -9.493295,                !- G-Function Ln(T/Ts) Value 42
    1.706601,                 !- G-Function G Value 42
    -9.369133,                !- G-Function Ln(T/Ts) Value 43
    1.773217,                 !- G-Function G Value 43
    -9.244971,                !- G-Function Ln(T/Ts) Value 44
    1.839433,                 !- G-Function G Value 44
    -9.120809,                !- G-Function Ln(T/Ts) Value 45
    1.905279,                 !- G-Function G Value 45
    -8.996648,                !- G-Function Ln(T/Ts) Value 46
    1.970785,                 !- G-Function G Value 46
    -8.872486,                !- G-Function Ln(T/Ts) Value 47
    2.035979,                 !- G-Function G Value 47
    -8.748324,                !- G-Function Ln(T/Ts) Value 48
    2.100886,                 !- G-Function G Value 48
    -8.624162,                !- G-Function Ln(T/Ts) Value 49
    2.165530,                 !- G-Function G Value 49
    -8.500000,                !- G-Function Ln(T/Ts) Value 50
    2.273322,                 !- G-Function G Value 50
    -7.800000,                !- G-Function Ln(T/Ts) Value 51
    2.617322,                 !- G-Function G Value 51
    -7.200000,                !- G-Function Ln(T/Ts) Value 52
    2.913796,                 !- G-Function G Value 52
    -6.500000,                !- G-Function Ln(T/Ts) Value 53
    3.270114,                 !- G-Function G Value 53
    -5.900000,                !- G-Function Ln(T/Ts) Value 54
    3.632967,                 !- G-Function G Value 54
    -5.200000,                !- G-Function Ln(T/Ts) Value 55
    4.270751,                 !- G-Function G Value 55
    -4.500000,                !- G-Function Ln(T/Ts) Value 56
    5.385970,                 !- G-Function G Value 56
    -3.963000,                !- G-Function Ln(T/Ts) Value 57
    6.614535,                 !- G-Function G Value 57
    -3.270000,                !- G-Function Ln(T/Ts) Value 58
    9.514729,                 !- G-Function G Value 58
    -2.864000,                !- G-Function Ln(T/Ts) Value 59
    11.884430,                !- G-Function G Value 59
    -2.577000,                !- G-Function Ln(T/Ts) Value 60
    13.917405,                !- G-Function G Value 60
    -2.171000,                !- G-Function Ln(T/Ts) Value 61
    17.276215,                !- G-Function G Value 61
    -1.884000,                !- G-Function Ln(T/Ts) Value 62
    19.987269,                !- G-Function G Value 62
    -1.191000,                !- G-Function Ln(T/Ts) Value 63
    27.202388,                !- G-Function G Value 63
    -0.497000,                !- G-Function Ln(T/Ts) Value 64
    34.744246,                !- G-Function G Value 64
    -0.274000,                !- G-Function Ln(T/Ts) Value 65
    36.928229,                !- G-Function G Value 65
    -0.051000,                !- G-Function Ln(T/Ts) Value 66
    38.950610,                !- G-Function G Value 66
    0.196000,                 !- G-Function Ln(T/Ts) Value 67
    40.938405,                !- G-Function G Value 67
    0.419000,                 !- G-Function Ln(T/Ts) Value 68
    42.516547,                !- G-Function G Value 68
    0.642000,                 !- G-Function Ln(T/Ts) Value 69
    43.874104,                !- G-Function G Value 69
    0.873000,                 !- G-Function Ln(T/Ts) Value 70
    45.060864,                !- G-Function G Value 70
    1.112000,                 !- G-Function Ln(T/Ts) Value 71
    46.062146,                !- G-Function G Value 71
    1.335000,                 !- G-Function Ln(T/Ts) Value 72
    46.806423,                !- G-Function G Value 72
    1.679000,                 !- G-Function Ln(T/Ts) Value 73
    47.649018,                !- G-Function G Value 73
    2.028000,                 !- G-Function Ln(T/Ts) Value 74
    48.218660,                !- G-Function G Value 74
    2.275000,                 !- G-Function Ln(T/Ts) Value 75
    48.496086,                !- G-Function G Value 75
    3.003000,                 !- G-Function Ln(T/Ts) Value 76
    48.956674;                !- G-Function G Value 76""")
int = Integer("64")
objparams_13 = IB_ObjParams(
    BoreHoleLength="76.2",
    BoreHoleRadius="0.05715",
    DesignFlowRate="0.1143",
    GroundThermalConductivity="2.493",
    GroundThermalHeatCapacity="2.4957E+6",
    GroutThermalConductivity="1.4714",
    MaximumLengthofSimulation="1",
    NumberofBoreHoles=int,
    PipeOutDiameter="0.0267",
    PipeThermalConductivity="0.389",
    PipeThickness="0.00243",
    UTubeDistance="0.047",
    DataFieldSetType="Ironbug.HVAC.IB_GroundHeatExchangerVertical_FieldSet")
groundhxvertical_2 = Ironbug_GroundHeatExchangerVertical(GFunctions=panel_12, Parameters_=objparams_13, dupNum=False)

c_script = CSharpScript(GPM="1020")  # -> m3s; inputs GPM: Double
# ---------- c_script: C# ----------
    m3s = GPM * 0.0000630902;
# ---------- end c_script ----------
objparams_14 = IB_ObjParams(
    Coefficient1OfthePartLoadPerformanceCurve="0",
    Coefficient2OfthePartLoadPerformanceCurve="0.0216",
    Coefficient3OfthePartLoadPerformanceCurve="-0.0325",
    Coefficient4OfthePartLoadPerformanceCurve="1.0095",
    RatedFlowRate=c_script,
    DataFieldSetType="Ironbug.HVAC.IB_PumpVariableSpeed_FieldSet")
pumpvariable_4 = Ironbug_PumpVariableSpeed(Parameters=objparams_14, dupNum=False)

c_script_2 = CSharpScript(GPM="950")  # -> m3s; inputs GPM: Double; same code as c_script
objparams_15 = IB_ObjParams(
    Coefficient1OfthePartLoadPerformanceCurve="0",
    Coefficient2OfthePartLoadPerformanceCurve="0.0216",
    Coefficient3OfthePartLoadPerformanceCurve="-0.0325",
    Coefficient4OfthePartLoadPerformanceCurve="1.0095",
    RatedFlowRate=c_script_2,
    DataFieldSetType="Ironbug.HVAC.IB_PumpVariableSpeed_FieldSet")
pumpvariable_5 = Ironbug_PumpVariableSpeed(Parameters=objparams_15, dupNum=False)

# ----
# GeoThermal Heat Pump Loop
pipeadiabatic_3 = Ironbug_PipeAdiabatic(dupNum=False)
pipeadiabatic_4 = Ironbug_PipeAdiabatic(dupNum=False)
plantbranches_3 = PlantBranches(B1=groundhxvertical_2, B2=pipeadiabatic_4, mapBranchToLoop=False)
spm_scheduled_3 = Ironbug_SetpointManagerScheduled(Temperature="20", dupNum=False)
objparams_16 = IB_ObjParams(Name="Heat Pump Loop", DataFieldSetType="Ironbug.HVAC.IB_PlantLoop_FieldSet")
plantbranches_4 = PlantBranches(B1=pipeadiabatic_3, B2=centralheatpumpsystem.ToDW_Demand, mapBranchToLoop=False)
merge_4 = Merge(Data1=pumpvariable_4, Data2=plantbranches_3, Data3=spm_scheduled_3)
condenserwaterloop_2 = Ironbug_CondenserWaterPlantLoop(Supply=merge_4, Demand=plantbranches_4, Parameters_=objparams_16, dupNum=False)

pipeadiabatic_5 = Ironbug_PipeAdiabatic(dupNum=False)

# ----
# Main Chilled water loop
panel_13 = Panel("45")
c_script_3 = CSharpScript(F=panel_13)  # -> C; inputs F: Double
# ---------- c_script_3: C# ----------
    C = (F - 32) * 5 / 9;
# ---------- end c_script_3 ----------
c_script_4 = CSharpScript(F="55")  # -> C; inputs F: Double; same code as c_script_3
branches_5 = PlantBranches(mapBranchToLoop=False)
objparams_17 = IB_ObjParams(DesignLoopExitTemperature=c_script_3, DataFieldSetType="Ironbug.HVAC.IB_SizingPlant_FieldSet")
objparams_18 = IB_ObjParams(MaximumLoopTemperature="98", MinimumLoopTemperature="1", DataFieldSetType="Ironbug.HVAC.IB_PlantLoop_FieldSet")
branches_6 = PlantBranches(B1=centralheatpumpsystem.ToCW_Supply, B2=pipeadiabatic_5, mapBranchToLoop=False)
spm_dual_2 = Ironbug_SetpointManagerScheduledDualSetpoint(HighTemperature=c_script_4, LowTemperature=c_script_3, dupNum=False)
sizingplant = Ironbug_SizingPlant(Parameters_=objparams_17, dupNum=False)
cwloop_2 = Ironbug_ChilledWaterPlantLoop(
    Supply=[pumpvariable_5, branches_6, spm_dual_2],
    Demand=branches_5,
    SizingLoop=sizingplant,
    Parameters_=objparams_18,
    dupNum=False)

objparams_19 = IB_ObjParams(
    Coefficient1OfthePartLoadPerformanceCurve="0",
    Coefficient2OfthePartLoadPerformanceCurve="0.0216",
    Coefficient3OfthePartLoadPerformanceCurve="-0.0325",
    Coefficient4OfthePartLoadPerformanceCurve="1.0095",
    DataFieldSetType="Ironbug.HVAC.IB_PumpVariableSpeed_FieldSet")
pumpvariable_6 = Ironbug_PumpVariableSpeed(Parameters=objparams_19, dupNum=False)

# ----
# Hot water loop
_130f = Panel("54.44")
pipeadiabatic_6 = Ironbug_PipeAdiabatic(dupNum=False)
branches_7 = PlantBranches(mapBranchToLoop=False)
objparams_20 = IB_ObjParams(DesignLoopExitTemperature=_130f, DataFieldSetType="Ironbug.HVAC.IB_SizingPlant_FieldSet")
spm_scheduled_4 = Ironbug_SetpointManagerScheduled(Temperature=_130f, dupNum=False)
plantbranches_5 = PlantBranches(Branch1=centralheatpumpsystem.ToHW_Supply, Branch=pipeadiabatic_6, mapBranchToLoop=False)
sizingplant_2 = Ironbug_SizingPlant(Parameters_=objparams_20, dupNum=False)
# DOAS
# DOAS
# DOAS
# HBZones
# DOAS
# Heat Pump Loop
# HBZones
# Heat Pump Loop
hwloop_2 = Ironbug_HotWaterPlantLoop(Supply=[pumpvariable_6, plantbranches_5, spm_scheduled_4], Demand=branches_7, SizingLoop=sizingplant_2, dupNum=False)

# ==== cluster Cluster

# ----
# Program
bldgprograms = HBBuildingPrograms({"LargeOffice", "MediumOffice", "SmallOffice", "MidriseApartment", "HighriseApartment", "Retail", "StripMall", "PrimarySchool", "SecondarySchool", "SmallHotel", "LargeHotel", "Hospital", "Outpatient", "Laboratory", "Warehouse", "SuperMarket", "FullServiceRestaurant", "QuickServiceRestaurant", "Courthouse", "LargeDataCenterHighITE", "LargeDataCenterLowITE", "SmallDataCenterHighITE", "SmallDataCenterLowITE"}, selected="MediumOffice")
applyloadvals = HBApplyLoadValues(room_or_program=flatten(bldgprograms), hot_wtr_per_floor="0")  # -> report, mod_obj; plug-in component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

# ----
# Construction Set
bldg_vintage = Dragonfly_BldgAge({"ASHRAE 90.1 2013  |  IECC 2015": "2013", "ASHRAE 90.1 2010  |  IECC 2012": "2010", "ASHRAE 90.1 2007  |  IECC 2009": "2007", "ASHRAE 90.1 2004  |  IECC 2006": "2004", "1980-2004 (CBECS)": "1980_2004", "Pre-1980 (CBECS)": "pre_1980"}, selected="ASHRAE 90.1 2013  |  IECC 2015")
climate_zone = Dragonfly_BldgAge({"1 - Very Hot": "1", "2 - Hot": "2", "3 - Warm": "3", "4 - Mixed": "4", "5 - Cool": "5", "6 - Cold": "6", "7 - Very Cold": "7", "8 - Subarctic": "8"}, selected="5 - Cool")
constr_type = Dragonfly_BldgAge({"SteelFramed", "WoodFramed", "Mass", "Metal Building"}, selected="SteelFramed")
constrsetclimate = HBConstructionSetByClimate(climate_zone=climate_zone, vintage=bldg_vintage, constr_type=constr_type)  # -> constr_set; plug-in component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

# ----
# Create Building
panel = Panel("3.5")
dup = DuplicateData(Data=panel, Number="1", Order=True)
geo = Geometry(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)
buildingfootprint = DFBuildingFromFootprint(
    footprint_geo=flatten(geo),
    floor_to_floor=flatten(dup),
    name="Sample Office",
    program=applyloadvals.mod_obj,
    constr_set=constrsetclimate,
    conditioned=Toggle(False),
    run=Toggle(True))  # -> report, buildings; plug-in component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
topbottom = DFSeparateTopBottom(buildings=buildingfootprint.buildings)  # -> buildings; plug-in component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

# ----
# Assign Windows
panel_2 = Panel("0.4")
simpleratiopar = DFSimpleWindowRatioParameters(ratio=panel_2)  # -> win_par; plug-in component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
applyfacadepar = DFApplyFacadeParameters(df_obj=topbottom, win_par=simpleratiopar)  # -> report, df_obj; plug-in component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

# ----
# Create Model
panel_3 = Panel("Sample Office Bldg")
# Model Setup
model = DFModel(buildings=flatten(applyfacadepar.df_obj), name=panel_3)  # -> report, model; plug-in component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

# ----
# Convert to HB
toggle = BooleanToggle(False)
tohoneybee = DFModelToHoneybee(model=model.model, use_multiplier=toggle, ceil_adjacency=Toggle(True), run=Toggle(True))  # -> report, hb_models; plug-in component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

hb_models = ClusterOutput(tohoneybee.hb_models)
