# Grasshopper definition sample_gshp_plant_v3.gh (Grasshopper 1.0.7)
# plug-ins: Ironbug.Grasshopper, CORE.Toolbox.Grasshopper

# ----
# Program
bldgprograms = HBBuildingPrograms({"LargeOffice", "MediumOffice", "SmallOffice", "MidriseApartment", "HighriseApartment", "Retail", "StripMall", "PrimarySchool", "SecondarySchool", "SmallHotel", "LargeHotel", "Hospital", "Outpatient", "Laboratory", "Warehouse", "SuperMarket", "FullServiceRestaurant", "QuickServiceRestaurant", "Courthouse", "LargeDataCenterHighITE", "LargeDataCenterLowITE", "SmallDataCenterHighITE", "SmallDataCenterLowITE"}, selected="MediumOffice")
# Create GSHP
panel = Panel("0")
applyloadvals = HBApplyLoadValues(room_or_program=flatten(bldgprograms), hot_wtr_per_floor=panel)  # -> report, mod_obj; plug-in component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

# ----
# Construction Set
bldg_vintage = Dragonfly_BldgAge({"ASHRAE 90.1 2013  |  IECC 2015": "2013", "ASHRAE 90.1 2010  |  IECC 2012": "2010", "ASHRAE 90.1 2007  |  IECC 2009": "2007", "ASHRAE 90.1 2004  |  IECC 2006": "2004", "1980-2004 (CBECS)": "1980_2004", "Pre-1980 (CBECS)": "pre_1980"}, selected="ASHRAE 90.1 2013  |  IECC 2015")
climate_zone = Dragonfly_BldgAge({"1 - Very Hot": "1", "2 - Hot": "2", "3 - Warm": "3", "4 - Mixed": "4", "5 - Cool": "5", "6 - Cold": "6", "7 - Very Cold": "7", "8 - Subarctic": "8"}, selected="5 - Cool")
constr_type = Dragonfly_BldgAge({"SteelFramed", "WoodFramed", "Mass", "Metal Building"}, selected="SteelFramed")
constrsetclimate = HBConstructionSetByClimate(climate_zone=climate_zone, vintage=bldg_vintage, constr_type=constr_type)  # -> constr_set; plug-in component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

gld_gfunct_idf_contents = Panel("""GroundHeatExchanger:Vertical,
    ,                                  !- Ground Heat Exchanger Name
    GHE Inlet Node,                    !- GHE Inlet Node
    GHE Outlet Node,                   !- GHE Outlet Node
    0.049887,                          !- Max GHE FlowRate {m3/s}
    70,                                !- Number of Boreholes
    152.40,                            !- Bore Hole Length {m}
    0.07620,                           !- Bore Hole Radius {m}
    2.683,                             !- Thermal conductivity (k) of Ground {W/m-K}
    2.5708E+06,                        !- Density x Specific Heat (rhoCp) of Ground {J/m^3-K}
    4.1966E+03,                        !- Specific Heat of Fluid {J/kg-K}
    12.9,                              !- Undisturbed temperature of Ground {C}
    0.049887,                          !- Design GHE Vol Flowrate {m3/s}
    2.077,                             !- Thermal conductivity (k) of Grout {W/m-K}
    0.389,                             !- Thermal conductivity (k)  of Pipe {W/m-K}
    0.609,                             !- Thermal conductivity (k) of Fluid {W/m-K}
    999.872,                           !- Density of Fluid (rho) {Kg/m^3}
    0.001,                             !- Dynamic viscosity of Fluid (mu) {N-s/m/62}
    0.04216,                           !- Pipe Outside Diameter {m}
    0.002,                             !- U-Tube Separation (Shank spacing) {m}
    0.00937,                           !- Pipe Wall Thickness {m}
    20,                                !- Maximum length of simulation in years
    41,                                !- Number of data pairs of the G function
    ! The G-function is defined by the following data pairs
    -15.00,   -0.592245,     !- LNTTS/GFNC Pair 1
    -14.50,   -0.342245,     !- LNTTS/GFNC Pair 2
    -14.00,   -0.092245,     !- LNTTS/GFNC Pair 3
    -13.50,   0.157755,      !- LNTTS/GFNC Pair 4
    -13.00,   0.407755,      !- LNTTS/GFNC Pair 5
    -12.50,   0.657755,      !- LNTTS/GFNC Pair 6
    -12.00,   0.907755,      !- LNTTS/GFNC Pair 7
    -11.50,   1.157755,      !- LNTTS/GFNC Pair 8
    -11.00,   1.407755,      !- LNTTS/GFNC Pair 9
    -10.50,   1.657755,      !- LNTTS/GFNC Pair 10
    -10.00,   1.907755,      !- LNTTS/GFNC Pair 11
    -9.50,    2.157755,      !- LNTTS/GFNC Pair 12
    -9.00,    2.407755,      !- LNTTS/GFNC Pair 13
    -8.50,    2.657755,      !- LNTTS/GFNC Pair 14
    -8.00,    2.907755,      !- LNTTS/GFNC Pair 15
    -7.50,    3.157755,      !- LNTTS/GFNC Pair 16
    -7.00,    3.407755,      !- LNTTS/GFNC Pair 17
    -6.50,    3.657755,      !- LNTTS/GFNC Pair 18
    -6.00,    3.907755,      !- LNTTS/GFNC Pair 19
    -5.50,    4.157755,      !- LNTTS/GFNC Pair 20
    -5.00,    4.407755,      !- LNTTS/GFNC Pair 21
    -4.50,    4.657755,      !- LNTTS/GFNC Pair 22
    -4.00,    6.755316,      !- LNTTS/GFNC Pair 23
    -3.50,    9.208137,      !- LNTTS/GFNC Pair 24
    -3.00,    11.108137,     !- LNTTS/GFNC Pair 25
    -2.50,    17.275607,     !- LNTTS/GFNC Pair 26
    -2.00,    23.458292,     !- LNTTS/GFNC Pair 27
    -1.50,    33.322808,     !- LNTTS/GFNC Pair 28
    -1.00,    48.377675,     !- LNTTS/GFNC Pair 29
    -0.50,    73.409518,     !- LNTTS/GFNC Pair 30
    0.00,     80.685877,     !- LNTTS/GFNC Pair 31
    0.50,     83.282284,     !- LNTTS/GFNC Pair 32
    1.00,     83.719598,     !- LNTTS/GFNC Pair 33
    1.50,     83.913331,     !- LNTTS/GFNC Pair 34
    2.00,     84.004843,     !- LNTTS/GFNC Pair 35
    2.50,     84.048071,     !- LNTTS/GFNC Pair 36
    3.00,     84.068490,     !- LNTTS/GFNC Pair 37
    3.50,     84.078136,     !- LNTTS/GFNC Pair 38
    4.00,     84.082692,     !- LNTTS/GFNC Pair 39
    4.50,     84.084844,     !- LNTTS/GFNC Pair 40
    5.00,     84.085860;     !- LNTTS/GFNC Pair 41""")
glhepro_gfunct_idf_contents = Panel("""  GroundHeatExchanger:Vertical,
    Vertical GHE,                    !- Name
    GHE Inlet Node,                  !- Inlet Node Name
    GHE Outlet Node,                 !- Outlet Node Name
    0.027760,                        !- Design Flow Rate {m3/s}
    70,                               !- Number of Boreholes
    152.40,                          !- Bore Hole Length {m}
    0.07620,                         !- Bore Hole Radius {m}
    2.683,                           !- Ground Thermal Conductivity {W/m-K}
    2.343E+06,                       !- Ground Thermal Heat Capacity {J/m3-K}
    12.9,                             !- Ground Temperature {C}
    2.077,                           !- Grout Thermal Conductivity {W/m-K}
    0.389,                           !- Pipe Thermal Conductivity {W/m-K}
    0.04216,                         !- Pipe Out Diameter {m}
    0.0227,                          !- U-Tube Distance {m}
    0.00470,                         !- Pipe Thickness {m}
    100,                             !- Maximum Length of Simulation {years}
    0.00050,                         !- G-Function Reference Ratio
    76,                              !- Number of Data Pairs of the G Function
    -15.831980,                      !- G-Function Ln(T/Ts) Value 1
    -1.631675,                      !- G-Function G Value 1
    -15.682348,                      !- G-Function Ln(T/Ts) Value 2
    -1.580976,                      !- G-Function G Value 2
    -15.532716,                      !- G-Function Ln(T/Ts) Value 3
    -1.527577,                      !- G-Function G Value 3
    -15.383083,                      !- G-Function Ln(T/Ts) Value 4
    -1.471157,                      !- G-Function G Value 4
    -15.233451,                      !- G-Function Ln(T/Ts) Value 5
    -1.411513,                      !- G-Function G Value 5
    -15.083819,                      !- G-Function Ln(T/Ts) Value 6
    -1.348510,                      !- G-Function G Value 6
    -14.934187,                      !- G-Function Ln(T/Ts) Value 7
    -1.282067,                      !- G-Function G Value 7
    -14.784554,                      !- G-Function Ln(T/Ts) Value 8
    -1.212150,                      !- G-Function G Value 8
    -14.634922,                      !- G-Function Ln(T/Ts) Value 9
    -1.138764,                      !- G-Function G Value 9
    -14.485290,                      !- G-Function Ln(T/Ts) Value 10
    -1.061956,                      !- G-Function G Value 10
    -14.335658,                      !- G-Function Ln(T/Ts) Value 11
    -0.981807,                      !- G-Function G Value 11
    -14.186025,                      !- G-Function Ln(T/Ts) Value 12
    -0.898433,                      !- G-Function G Value 12
    -14.036393,                      !- G-Function Ln(T/Ts) Value 13
    -0.811980,                      !- G-Function G Value 13
    -13.886761,                      !- G-Function Ln(T/Ts) Value 14
    -0.722630,                      !- G-Function G Value 14
    -13.737129,                      !- G-Function Ln(T/Ts) Value 15
    -0.630595,                      !- G-Function G Value 15
    -13.587496,                      !- G-Function Ln(T/Ts) Value 16
    -0.536120,                      !- G-Function G Value 16
    -13.437864,                      !- G-Function Ln(T/Ts) Value 17
    -0.439484,                      !- G-Function G Value 17
    -13.288232,                      !- G-Function Ln(T/Ts) Value 18
    -0.340998,                      !- G-Function G Value 18
    -13.138600,                      !- G-Function Ln(T/Ts) Value 19
    -0.241003,                      !- G-Function G Value 19
    -12.988967,                      !- G-Function Ln(T/Ts) Value 20
    -0.139866,                      !- G-Function G Value 20
    -12.839335,                      !- G-Function Ln(T/Ts) Value 21
    -0.037970,                      !- G-Function G Value 21
    -12.689703,                      !- G-Function Ln(T/Ts) Value 22
    0.064297,                      !- G-Function G Value 22
    -12.540071,                      !- G-Function Ln(T/Ts) Value 23
    0.166552,                      !- G-Function G Value 23
    -12.390438,                      !- G-Function Ln(T/Ts) Value 24
    0.268434,                      !- G-Function G Value 24
    -12.240806,                      !- G-Function Ln(T/Ts) Value 25
    0.369611,                      !- G-Function G Value 25
    -12.091174,                      !- G-Function Ln(T/Ts) Value 26
    0.469798,                      !- G-Function G Value 26
    -11.941542,                      !- G-Function Ln(T/Ts) Value 27
    0.568759,                      !- G-Function G Value 27
    -11.791909,                      !- G-Function Ln(T/Ts) Value 28
    0.666314,                      !- G-Function G Value 28
    -11.642277,                      !- G-Function Ln(T/Ts) Value 29
    0.762340,                      !- G-Function G Value 29
    -11.492645,                      !- G-Function Ln(T/Ts) Value 30
    0.856766,                      !- G-Function G Value 30
    -11.343013,                      !- G-Function Ln(T/Ts) Value 31
    0.949570,                      !- G-Function G Value 31
    -11.193380,                      !- G-Function Ln(T/Ts) Value 32
    1.040773,                      !- G-Function G Value 32
    -11.043748,                      !- G-Function Ln(T/Ts) Value 33
    1.130427,                      !- G-Function G Value 33
    -10.894116,                      !- G-Function Ln(T/Ts) Value 34
    1.218608,                      !- G-Function G Value 34
    -10.744484,                      !- G-Function Ln(T/Ts) Value 35
    1.305410,                      !- G-Function G Value 35
    -10.594851,                      !- G-Function Ln(T/Ts) Value 36
    1.390935,                      !- G-Function G Value 36
    -10.445219,                      !- G-Function Ln(T/Ts) Value 37
    1.475291,                      !- G-Function G Value 37
    -10.295587,                      !- G-Function Ln(T/Ts) Value 38
    1.558585,                      !- G-Function G Value 38
    -10.145955,                      !- G-Function Ln(T/Ts) Value 39
    1.640920,                      !- G-Function G Value 39
    -9.996322,                      !- G-Function Ln(T/Ts) Value 40
    1.722393,                      !- G-Function G Value 40
    -9.846690,                      !- G-Function Ln(T/Ts) Value 41
    1.803096,                      !- G-Function G Value 41
    -9.697058,                      !- G-Function Ln(T/Ts) Value 42
    1.883113,                      !- G-Function G Value 42
    -9.547426,                      !- G-Function Ln(T/Ts) Value 43
    1.962519,                      !- G-Function G Value 43
    -9.397793,                      !- G-Function Ln(T/Ts) Value 44
    2.041384,                      !- G-Function G Value 44
    -9.248161,                      !- G-Function Ln(T/Ts) Value 45
    2.119769,                      !- G-Function G Value 45
    -9.098529,                      !- G-Function Ln(T/Ts) Value 46
    2.197729,                      !- G-Function G Value 46
    -8.948897,                      !- G-Function Ln(T/Ts) Value 47
    2.275314,                      !- G-Function G Value 47
    -8.799264,                      !- G-Function Ln(T/Ts) Value 48
    2.352567,                      !- G-Function G Value 48
    -8.649632,                      !- G-Function Ln(T/Ts) Value 49
    2.429528,                      !- G-Function G Value 49
    -8.500000,                      !- G-Function Ln(T/Ts) Value 50
    2.679000,                       !- G-Function G Value 50
    -7.800000,                      !- G-Function Ln(T/Ts) Value 51
    3.025620,                       !- G-Function G Value 51
    -7.200000,                      !- G-Function Ln(T/Ts) Value 52
    3.341750,                       !- G-Function G Value 52
    -6.500000,                      !- G-Function Ln(T/Ts) Value 53
    3.800629,                       !- G-Function G Value 53
    -5.900000,                      !- G-Function Ln(T/Ts) Value 54
    4.388195,                       !- G-Function G Value 54
    -5.200000,                      !- G-Function Ln(T/Ts) Value 55
    5.531960,                       !- G-Function G Value 55
    -4.500000,                      !- G-Function Ln(T/Ts) Value 56
    7.540571,                       !- G-Function G Value 56
    -3.963000,                      !- G-Function Ln(T/Ts) Value 57
    9.810654,                       !- G-Function G Value 57
    -3.270000,                      !- G-Function Ln(T/Ts) Value 58
    14.587778,                       !- G-Function G Value 58
    -2.864000,                      !- G-Function Ln(T/Ts) Value 59
    18.325627,                       !- G-Function G Value 59
    -2.577000,                      !- G-Function Ln(T/Ts) Value 60
    21.436877,                       !- G-Function G Value 60
    -2.171000,                      !- G-Function Ln(T/Ts) Value 61
    26.414134,                       !- G-Function G Value 61
    -1.884000,                      !- G-Function Ln(T/Ts) Value 62
    30.301547,                       !- G-Function G Value 62
    -1.191000,                      !- G-Function Ln(T/Ts) Value 63
    40.207352,                       !- G-Function G Value 63
    -0.497000,                      !- G-Function Ln(T/Ts) Value 64
    49.834993,                       !- G-Function G Value 64
    -0.274000,                      !- G-Function Ln(T/Ts) Value 65
    52.551017,                       !- G-Function G Value 65
    -0.051000,                      !- G-Function Ln(T/Ts) Value 66
    55.008958,                       !- G-Function G Value 66
    0.196000,                      !- G-Function Ln(T/Ts) Value 67
    57.418983,                       !- G-Function G Value 67
    0.419000,                      !- G-Function Ln(T/Ts) Value 68
    59.308604,                       !- G-Function G Value 68
    0.642000,                      !- G-Function Ln(T/Ts) Value 69
    60.924545,                       !- G-Function G Value 69
    0.873000,                      !- G-Function Ln(T/Ts) Value 70
    62.330963,                       !- G-Function G Value 70
    1.112000,                      !- G-Function Ln(T/Ts) Value 71
    63.516248,                       !- G-Function G Value 71
    1.335000,                      !- G-Function Ln(T/Ts) Value 72
    64.400898,                       !- G-Function G Value 72
    1.679000,                      !- G-Function Ln(T/Ts) Value 73
    65.404417,                       !- G-Function G Value 73
    2.028000,                      !- G-Function Ln(T/Ts) Value 74
    66.083386,                       !- G-Function G Value 74
    2.275000,                      !- G-Function Ln(T/Ts) Value 75
    66.413523,                       !- G-Function G Value 75
    3.003000,                      !- G-Function Ln(T/Ts) Value 76
    66.961987;                        !- G-Function G Value 76""")

# ---- group: Set to True to Read Excel File
toggle = BooleanToggle(True)

# ---- group: Set the Path to the Plant Load Excel File
path = FilePath("C:\Users\chris\Downloads\2024-0209 plant loads.xlsx")

# ---- group: Process Excel of Hourly Loads in Btu/h into Watts
# Building Loads From Excel File
xl_in = ReadFromExcel(WorkbookFilepath=path, Live=False, Stream=toggle)
flip = FlipMatrix(Data=xl_in)
panel_2 = Panel("""0
1""")
panel_3 = Panel("""2
3
4
5""")
cull_i = CullIndex(List=flip, Indices=panel_2, Wrap=True)  # -> simplify(List)
branch = TreeBranch(Tree=cull_i, Path=panel_3, MaintainPaths=True)
units = LBUnitConverter(values=branch, from_u="Btu/h", to_u="W")  # -> all_u, values; plug-in component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
bang = ExplodeTree(Data=units.values)  # -> Branch0, Branch1, Branch2, Branch3

# ----
# Auxilary Air-Source
# Chiller / Heat Pump
# Cooling
# Heating
objparams = IB_ObjParams(DataFieldSetType="Ironbug.HVAC.IB_HeatPumpPlantLoopEIRHeating_FieldSet")
objparams_2 = IB_ObjParams(DataFieldSetType="Ironbug.HVAC.IB_HeatPumpPlantLoopEIRCooling_FieldSet")
clnhp_airsource = IB_HeatPumpPlantLoopEIRCooling_AirSource(Parameters_=objparams_2, dupNum=False)
htnhp_airsource = IB_HeatPumpPlantLoopEIRHeating_AirSource(Parameters_=objparams, dupNum=False)

# ----
# Create Building
panel_4 = Panel("3.5")
dup = DuplicateData(Data=panel_4, Number="1", Order=True)
geo = Geometry(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)
buildingfootprint = DFBuildingFromFootprint(
    footprint_geo=flatten(geo),
    floor_to_floor=flatten(dup),
    name="Sample Office",
    program=applyloadvals.mod_obj,
    constr_set=constrsetclimate,
    conditioned=Toggle(False),
    run=Toggle(True))  # -> report, buildings; plug-in component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
topbottom = DFSeparateTopBottom(buildings=buildingfootprint.buildings)  # -> buildings; plug-in component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

# ----
# Format the G-Function
python = GhPythonScript(idf_str=gld_gfunct_idf_contents)  # -> other_par, g_funct; inputs idf_str: list
# ---------- python: Python ----------
from honeybee_energy.reader import parse_idf_string
from ladybug_rhino.grasshopper import all_required_inputs


if all_required_inputs(ghenv.Component):
    idf_vals = parse_idf_string('\n'.join(_idf_str))
    g_start_i = [i for i, l in enumerate(_idf_str) if 'number of data pairs' in l.lower()]
    g_funct = idf_vals[g_start_i[0]:]
    other_par = idf_vals[:g_start_i[0]]
    if len(other_par) == 18:
        order_i = [6, 7, 4, 10, 8, 9, 11, 5, 13, 12, 15, 14]
        other_par = [other_par[i - 1] for i in order_i]
    elif len(other_par) == 22:
        order_i = [6, 7, 4, 11, 8, 9, 13, 5, 18, 14, 20, 19]
        other_par = [other_par[i - 1] for i in order_i]
# ---------- end python ----------
panel_5 = Panel(python.g_funct)

# ----
# Properties of the GHE
# from the IDF File Contents
bang_2 = ExplodeTree(Data=simplify(graft(python.other_par)))  # -> Branch0, Branch1, Branch2, Branch3, Branch4, Branch5, Branch6, Branch7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
objparams_3 = IB_ObjParams(
    BoreHoleLength=bang_2.Branch0,
    BoreHoleRadius=bang_2.Branch1,
    DesignFlowRate=bang_2.Branch2,
    GroundTemperature=bang_2.Branch3,
    GroundThermalConductivity=bang_2.Branch4,
    GroundThermalHeatCapacity=bang_2.Branch5,
    GroutThermalConductivity=bang_2.Branch6,
    NumberofBoreHoles=bang_2.Branch7,
    PipeOutDiameter=bang_2.Branch8,
    PipeThermalConductivity=bang_2.Branch9,
    PipeThickness=bang_2.Branch10,
    UTubeDistance=bang_2.Branch11,
    DataFieldSetType="Ironbug.HVAC.IB_GroundHeatExchangerVertical_FieldSet")

addition = Addition(A=bang.Branch2, B=bang.Branch3)
addition_2 = Addition(A=bang.Branch0, B=bang.Branch1)
heatpumpcooling = IB_HeatPumpWaterToWaterEquationFitCooling(dupNum=False)  # -> HP, toSupplySide
heatpumpheating = IB_HeatPumpWaterToWaterEquationFitHeating(dupNum=False)  # -> HP, toSupplySide
cooling_load = Data(addition_2)

constrheader = LBConstructHeader(data_type="Power", unit="W")  # -> header; plug-in component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
data = LBConstructData(header=constrheader, values=cooling_load)  # -> data; plug-in component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
timeop = LBTimeIntervalOperation(data=data)  # -> daily, monthly, mon_per_hr; plug-in component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
xdata = LBDeconstructData(data=timeop.daily)  # -> header, values; plug-in component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
datadt = LBDataDateTimes(data=timeop.daily)  # -> hoys; plug-in component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
python_2 = GhPythonScript(values=xdata.values, dates=datadt)  # -> out, max_date, max_val; inputs values: list, dates: list
# ---------- python_2: Python ----------
from ladybug.dt import Date

data = [(x, y) for y, x in sorted(zip(_values, _dates), key=lambda pair: pair[0])]
max_date = Date.from_doy(data[-1][0])
max_val = data[-1][1]
# ---------- end python_2 ----------

heaing_load = Data(addition)

constrheader_2 = LBConstructHeader(data_type="Power", unit="W")  # -> header; plug-in component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
data_2 = LBConstructData(header=constrheader_2, values=heaing_load)  # -> data; plug-in component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
timeop_2 = LBTimeIntervalOperation(data=data_2)  # -> daily, monthly, mon_per_hr; plug-in component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
xdata_2 = LBDeconstructData(data=timeop_2.daily)  # -> header, values; plug-in component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
datadt_2 = LBDataDateTimes(data=timeop_2.daily)  # -> hoys; plug-in component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
python_3 = GhPythonScript(values=xdata_2.values, dates=datadt_2)  # -> out, max_date, max_val; inputs values: list, dates: list; same code as python_2

# ----
# Assign Windows
panel_6 = Panel("0.4")
simpleratiopar = DFSimpleWindowRatioParameters(ratio=panel_6)  # -> win_par; plug-in component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
applyfacadepar = DFApplyFacadeParameters(df_obj=topbottom, win_par=simpleratiopar)  # -> report, df_obj; plug-in component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

tounit = LBToUnit(data=[data, data_2], to_unit="TR")  # -> all_unit, data; plug-in component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
python_4 = GhPythonScript(x=tounit.data)  # -> a
# ---------- python_4: Python ----------
a = x.max * 0.000189 * 10  # convert to m3/s
# ---------- end python_4 ----------

# ----
# Create Model
panel_7 = Panel("Sample Office Bldg")
# Model Setup
model = DFModel(buildings=flatten(applyfacadepar.df_obj), name=panel_7)  # -> report, model; plug-in component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

hourlyplot = LBHourlyPlot(data=flatten(tounit.data))  # -> report, mesh, legend, borders, labels, title, vis_set; plug-in component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
bang_3 = ExplodeTree(Data=python_4)  # -> flatten(Branch0), flatten(Branch1)

python_5 = GhPythonScript(loads=cooling_load, name="HHW")  # -> csv_file; inputs loads: list
# ---------- python_5: Python ----------
import os
from honeybee.config import folders
from ladybug_rhino.grasshopper import all_required_inputs

if all_required_inputs(ghenv.Component):
    folder = folders.default_simulation_folder
    csv_file = os.path.join(folder, '{}.csv'.format(_name))
    with open(csv_file, 'w') as csv_f:
        csv_f.write('\n'.join(str(v) for v in _loads))
# ---------- end python_5 ----------
schedulefile = IB_ScheduleFile(_csvFile=python_5, dupNum=False)
objparams_4 = IB_ObjParams(LoadSchedule=schedulefile, PeakFlowRate=bang_3.Branch1, DataFieldSetType="Ironbug.HVAC.IB_LoadProfilePlant_FieldSet")
loadprofile = IB_LoadProfilePlant(Parameters_=objparams_4, dupNum=False)

python_6 = GhPythonScript(loads=heaing_load, name="LTCHW")  # -> csv_file; inputs loads: list; same code as python_5
schedulefile_2 = IB_ScheduleFile(_csvFile=python_6, dupNum=False)
objparams_5 = IB_ObjParams(LoadSchedule=schedulefile_2, PeakFlowRate=bang_3.Branch0, DataFieldSetType="Ironbug.HVAC.IB_LoadProfilePlant_FieldSet")
loadprofile_2 = IB_LoadProfilePlant(Parameters_=objparams_5, dupNum=False)

# ----
# Hot water loop
panel_8 = Panel("0")
objparams_6 = IB_ObjParams(
    Coefficient1OfthePartLoadPerformanceCurve=panel_8,
    Coefficient2OfthePartLoadPerformanceCurve="0.0216",
    Coefficient3OfthePartLoadPerformanceCurve="-0.0325",
    Coefficient4OfthePartLoadPerformanceCurve="1.0095",
    RatedPumpHead="119563",
    DataFieldSetType="Ironbug.HVAC.IB_PumpVariableSpeed_FieldSet")
exit_temp_c = Panel("54.444")
pumpvariable = Ironbug_PumpVariableSpeed(Parameters=objparams_6, dupNum=False)
spm_scheduled = Ironbug_SetpointManagerScheduled(Temperature=exit_temp_c, dupNum=False)
branches = PlantBranches(Branch1=heatpumpheating.toSupplySide, mapBranchToLoop=False)
branches_2 = PlantBranches(Branch1=loadprofile, mapBranchToLoop=False)
objparams_7 = IB_ObjParams(Name="Hot Water Loop", DataFieldSetType="Ironbug.HVAC.IB_PlantLoop_FieldSet")
hwloop = Ironbug_HotWaterPlantLoop(Supply=[pumpvariable, branches, spm_scheduled], Demand=branches_2, Parameters=objparams_7, dupNum=False)

panel_9 = Panel([python_3.max_date, python_3.max_val])
panel_10 = Panel("1")

# ----
# Low temp chilled water loop
panel_11 = Panel("0")
objparams_8 = IB_ObjParams(
    Coefficient1OfthePartLoadPerformanceCurve=panel_11,
    Coefficient2OfthePartLoadPerformanceCurve="0.0216",
    Coefficient3OfthePartLoadPerformanceCurve="-0.0325",
    Coefficient4OfthePartLoadPerformanceCurve="1.0095",
    RatedPumpHead="119563",
    DataFieldSetType="Ironbug.HVAC.IB_PumpVariableSpeed_FieldSet")
exit_temp_c_2 = Panel("5.555")
pumpvariable_2 = Ironbug_PumpVariableSpeed(Parameters=objparams_8, dupNum=False)
plantbranches = PlantBranches(Branch1=heatpumpcooling.toSupplySide, mapBranchToLoop=False)
spm_scheduled_2 = Ironbug_SetpointManagerScheduled(Temperature=exit_temp_c_2, dupNum=False)
branches_3 = PlantBranches(Branch=loadprofile_2, mapBranchToLoop=False)
objparams_9 = IB_ObjParams(Name="Low Temperature Chilled Water Loop", DataFieldSetType="Ironbug.HVAC.IB_PlantLoop_FieldSet")
cwloop = Ironbug_ChilledWaterPlantLoop(Supply=[pumpvariable_2, plantbranches, spm_scheduled_2], Demand=branches_3, Parameters_=objparams_9, dupNum=False)

panel_12 = Panel([python_2.max_date, python_2.max_val])

# ----
# Convert to HB
toggle_2 = BooleanToggle(False)
tohoneybee = DFModelToHoneybee(model=model.model, use_multiplier=toggle_2, ceil_adjacency=Toggle(True), run=Toggle(True))  # -> report, hb_models; plug-in component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

# ----
# Ground Loop
groundhxvertical = Ironbug_GroundHeatExchangerVertical(GFunctions=python.g_funct, Parameters_=objparams_3, dupNum=False)
pipeadiabatic = IB_PipeAdiabatic(dupNum=False)
maximum_loop_temp_c = Panel("29.444")
minimum_loop_temp_c = Panel("10")
pipeadiabatic_2 = Ironbug_PipeAdiabatic(dupNum=False)
merge = Merge(Data1=flatten(clnhp_airsource), Data2=flatten(htnhp_airsource))
spm_dual = IB_SetpointManagerScheduledDualSetpoint(HighTemperature=maximum_loop_temp_c, LowTemperature=minimum_loop_temp_c, dupNum=False)
plantbranches_2 = PlantBranches(B1=heatpumpheating.HP, B2=heatpumpcooling.HP, B3=pipeadiabatic_2, mapBranchToLoop=False)
branches_4 = PlantBranches(B1=pipeadiabatic, B2=merge, mapBranchToLoop=False)
objparams_10 = IB_ObjParams(Name="Ground Exchanger Loop", DataFieldSetType="Ironbug.HVAC.IB_PlantLoop_FieldSet")
pumpvariable_3 = Ironbug_PumpVariableSpeed(dupNum=False)
merge_2 = Merge(Data1=flatten(pumpvariable_3), Data2=flatten(branches_4), Data3=flatten(spm_dual))
condenserwaterloop = Ironbug_CondenserWaterPlantLoop(Supply=merge_2, Demand=plantbranches_2, Parameters_=objparams_10, dupNum=False)

merge_3 = Merge(Data1=cwloop, Data2=hwloop, Data3=condenserwaterloop)
hvacsystem = Ironbug_HVACSystem(PlantLoops=flatten(merge_3))
toggle_3 = BooleanToggle(False)

# ----
# Central
# Water-To-Water
# Heat Pumps
objparams_11 = IB_ObjParams(DataFieldSetType="Ironbug.HVAC.IB_ChillerHeaterPerformanceElectricEIR_FieldSet")
chillerheater = IB_ChillerHeaterPerformanceElectricEIR(Parameters_=objparams_11, dupNum=False)

duplicate = IB_Duplicate(Reference=chillerheater, Amount="3")  # -> Objects, graft(port)

centralheatpumpsystem = IB_CentralHeatPumpSystem(ChillerHeaters=duplicate.Objects, dupNum=False)  # -> ToDW_Demand, ToCW_Supply, ToHW_Supply

# ----
# Export OSM
panel_13 = Panel("https://energyplus-weather.s3.amazonaws.com/north_and_central_america_wmo_region_4/USA/NJ/USA_NJ_Trenton-Mercer.County.AP.724095_TMY3/USA_NJ_Trenton-Mercer.County.AP.724095_TMY3.zip")
downloadepw = LBDownloadWeather(weather_URL=panel_13)  # -> epw_file, stat_file, ddy_file; plug-in component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

importddy = LBImportDDY(ddy_file=downloadepw.ddy_file)  # -> location, design_days, cooling_ddy, heating_ddy; plug-in component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
decnstrdesignday = LBDeconstructDesignDay(design_day=importddy.cooling_ddy)  # -> name, day_type, location, date, dry_bulb_max, dry_bulb_range, humidity_type, humidity_value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; plug-in component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
decnstrdesignday_2 = LBDeconstructDesignDay(design_day=importddy.heating_ddy)  # -> name, day_type, location, date, dry_bulb_max, dry_bulb_range, humidity_type, humidity_value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; plug-in component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
constrdesignday = DFConstructDesignDay(
    name=decnstrdesignday.name,
    day_type=decnstrdesignday.day_type,
    location=decnstrdesignday.location,
    date=python_2.max_date,
    dry_bulb_max=decnstrdesignday.dry_bulb_max,
    dry_bulb_range=decnstrdesignday.dry_bulb_range,
    humidity_type=decnstrdesignday.humidity_type,
    humidity_value=decnstrdesignday.humidity_value,
    barometric_p=decnstrdesignday.barometric_p,
    wind_speed=decnstrdesignday.wind_speed,
    wind_dir=decnstrdesignday.wind_dir,
    sky_type=decnstrdesignday.sky_type,
    sky_properties=decnstrdesignday.sky_properties)  # -> design_day; plug-in component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
constrdesignday_2 = DFConstructDesignDay(
    name=decnstrdesignday_2.name,
    day_type=decnstrdesignday_2.day_type,
    location=decnstrdesignday_2.location,
    date=python_3.max_date,
    dry_bulb_max=decnstrdesignday_2.dry_bulb_max,
    dry_bulb_range=decnstrdesignday_2.dry_bulb_range,
    humidity_type=decnstrdesignday_2.humidity_type,
    humidity_value=decnstrdesignday_2.humidity_value,
    barometric_p=decnstrdesignday_2.barometric_p,
    wind_speed=decnstrdesignday_2.wind_speed,
    wind_dir=decnstrdesignday_2.wind_dir,
    sky_type=decnstrdesignday_2.sky_type,
    sky_properties=decnstrdesignday_2.sky_properties)  # -> design_day; plug-in component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
writeddy = DFWriteDDY(location=importddy.location, design_days=flatten([constrdesignday, constrdesignday_2]), run=Toggle(True))  # -> ddy_file; plug-in component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
sizingpar = HBSizingParameter(ddy_file=writeddy)  # -> sizing; plug-in component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
simpar = HBSimulationParameter(timestep=6, sizing=sizingpar)  # -> sim_par; plug-in component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

modeltoosm = HBModelToOSM(model=tohoneybee.hb_models, epw_file=downloadepw.epw_file, sim_par=simpar, write=Toggle(False), run="2")  # -> report, jsons, osw, osm, idf, sql, zsz, rdd, html; plug-in component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

savetofile = IB_SaveToFile(NewFilePath=modeltoosm.osm, HVACSystem=hvacsystem, _writeOpen=Toggle(False), OverrideMode=False, writeMode=1)
runosm = HBRunOSM(osm=savetofile, epw_file=downloadepw.epw_file, translate=toggle_3, run=toggle_3)  # -> report, idf, sql, zsz, rdd, html; plug-in component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
# DOAS
# DOAS
# HBZones
# Heat Pump Loop
panel_14 = Panel(runosm.report)
